# Dynamo graph Family_Data_Cleaner.dyn (Dynamo 2.12.0.5650)
# packages: Orchid 212.4.0.5911, Clockwork for Dynamo 2.x 2.6.0

# group: By Type
seleziona_tipo_famiglia = FamilyTypes("Schueco_FWS_AWS-75-SI+_optimized_inw_Family-01:FWS SI insert unit")  # graph input
family = FamilyType.Family(familyType=seleziona_tipo_famiglia)

# group: Edit Document
o_family_edit = Orchid.RevitProject.Elements.Family.Edit(family=family)
o_familytype_current = Orchid.RevitFamily.FamilyType.Current(familyDocument=o_family_edit)
o_familydocument_parameters = Orchid.RevitFamily.FamilyDocument.Parameters(familyDocument=o_family_edit)

# group: Read Data
name = FamilyParameter.Name(familyParameter=o_familydocument_parameters)
o_familyparameter_getvalue = Orchid.RevitFamily.FamilyParameter.GetValue(familyDocument=o_family_edit, familyType=o_familytype_current, parameterName=name)
watch = Watch(o_familyparameter_getvalue.valueByType)
watch_2 = Watch(name)

# group: By Category
categories = Categories("OST_Doors")  # frozen
all_family_types_of_category = Custom[All Family Types Of Category](category=categories)  # package Clockwork for Dynamo 2.x; Gets all family types/symbols of a given category in the model.
family_2 = FamilyType.Family(familyType=all_family_types_of_category)

# group: Brand Finder
list_create = List.Create(item0=o_familyparameter_getvalue.valueByType)
firstItem = List.FirstItem(list=list_create@L3)
string_from_object = FromObject(object=firstItem)
cosa_vuoi_rimuovere = StringInput("schueco")  # graph input
boolean = BoolSelector(true)
contains = String.Contains(string=string_from_object, searchFor=cosa_vuoi_rimuovere, ignoreCase=boolean)
boolean_2 = BoolSelector(true)
allIndicesOf = List.AllIndicesOf(list=contains@L2, item=boolean_2)

# group: Split Parameters
getItemAtIndex = List.GetItemAtIndex(list=name@L2, index=allIndicesOf@L2)
canAssignFormula = FamilyParameter.CanAssignFormula(familyParameter=o_familydocument_parameters)
getItemAtIndex_2 = List.GetItemAtIndex(list=canAssignFormula@L2, index=allIndicesOf@L2)
filterByBoolMask = List.FilterByBoolMask(list=getItemAtIndex, mask=getItemAtIndex_2)
flatten = List.Flatten(list=filterByBoolMask.out)
flatten_2 = List.Flatten(list=filterByBoolMask.in)

# group: Await For Transaction
o_datastream_await = Orchid.Common.DataStream.Await(pass=o_family_edit, waitFor=o_familyparameter_getvalue.valueByType)
o_datastream_await_2 = Orchid.Common.DataStream.Await(pass=o_datastream_await, waitFor=flatten)
o_datastream_await_3 = Orchid.Common.DataStream.Await(pass=o_datastream_await_2, waitFor=flatten_2)
end = Revit.Transaction.Transaction.End(input=o_datastream_await_3)

# group: Empty Parameter Values
string = StringInput("")
o_familyparameter_setvalue = Orchid.RevitFamily.FamilyParameter.SetValue(familyDocument=end, familyType=o_familytype_current, parameterName=flatten@L1, value=string)

# group: Empty Formula Values
string_2 = StringInput("\"\"")
o_formula_set = Orchid.RevitFamily.Formula.Set(familyDocument=end, parameterName=flatten_2, value=string_2)

# group: Reload Family
o_datastream_await_4 = Orchid.Common.DataStream.Await(pass=family, waitFor=o_familyparameter_setvalue)
o_datastream_await_5 = Orchid.Common.DataStream.Await(pass=o_datastream_await_4, waitFor=o_formula_set)
name_2 = FamilyType.Name(familyType=seleziona_tipo_famiglia)
RUN = BoolSelector(false)
set_parameter = Python(IN[0]=o_datastream_await_5, IN[1]=name_2, IN[4]=RUN)  # IronPython2; unwired: IN[2], IN[3]
# ---------- set_parameter.python (68 lines) ----------
import clr

clr.AddReference('RevitAPI')
from Autodesk.Revit.DB import *
from Autodesk.Revit.DB.Structure import *

clr.AddReference('RevitAPIUI')
from Autodesk.Revit.UI import *

clr.AddReference('System')
from System.Collections.Generic import List

clr.AddReference('RevitNodes')
import Revit
clr.ImportExtensions(Revit.GeometryConversion)
clr.ImportExtensions(Revit.Elements)

clr.AddReference('RevitServices')
import RevitServices
from RevitServices.Persistence import DocumentManager
from RevitServices.Transactions import TransactionManager

class FamilyOption(IFamilyLoadOptions):
	def OnFamilyFound(self,familyInUse,overwriteParameterValues):
		overwriteParameterValues = True
		return True
		
	def OnSharedFamilyFound(self, sharedFamily, familyInUse, FamilySource, overwriteParameterValues):
		overwriteParameterValues = True
		return True

doc = DocumentManager.Instance.CurrentDBDocument
uidoc=DocumentManager.Instance.CurrentUIApplication.ActiveUIDocument

#Preparing input from dynamo to revit
family = UnwrapElement(IN[0])
docs = []

#Do some action in a Transaction
TransactionManager.Instance.EnsureInTransaction(doc)
for symbId in family.GetFamilySymbolIds():
	symbol = doc.GetElement(symbId)
	if not symbol.IsActive:
		symbol.Activate()
		
TransactionManager.Instance.TransactionTaskDone()
TransactionManager.Instance.ForceCloseTransaction()
try:
	famDoc= doc.EditFamily(family)
	params = famDoc.FamilyManager.Parameters
	types = famDoc.FamilyManager.Types
	trans = Transaction(famDoc)
	trans.Start("test")
	for type in types:
		if type.Name == IN[1]:
			famDoc.FamilyManager.CurrentType = type
	for param in params:
		if param.Definition.Name == IN[2]:
			docs.append(famDoc.FamilyManager.Set(param,IN[3]))
	trans.Commit()
	famDoc.LoadFamily(doc,FamilyOption())
	famDoc.Close(False)
except:
	docs.append("Failed")



OUT = docs
# ----------------------------------------
