# Dynamo graph Family_Python_Loader.dyn "Family_Data_Python" (Dynamo 2.12.0.5650)

family_types = FamilyTypes("Schueco_ADS-80-FR-30_out_Family-10:Type 1")  # graph input
family = FamilyType.Family(familyType=family_types)
name = FamilyType.Name(familyType=family_types)
RUN = BoolSelector(false)
set_parameter = Python(IN[0]=family, IN[1]=name, IN[4]=RUN)  # IronPython2; unwired: IN[2], IN[3]
# ---------- set_parameter.python (68 lines) ----------
import clr

clr.AddReference('RevitAPI')
from Autodesk.Revit.DB import *
from Autodesk.Revit.DB.Structure import *

clr.AddReference('RevitAPIUI')
from Autodesk.Revit.UI import *

clr.AddReference('System')
from System.Collections.Generic import List

clr.AddReference('RevitNodes')
import Revit
clr.ImportExtensions(Revit.GeometryConversion)
clr.ImportExtensions(Revit.Elements)

clr.AddReference('RevitServices')
import RevitServices
from RevitServices.Persistence import DocumentManager
from RevitServices.Transactions import TransactionManager

class FamilyOption(IFamilyLoadOptions):
	def OnFamilyFound(self,familyInUse,overwriteParameterValues):
		overwriteParameterValues = True
		return True
		
	def OnSharedFamilyFound(self, sharedFamily, familyInUse, FamilySource, overwriteParameterValues):
		overwriteParameterValues = True
		return True

doc = DocumentManager.Instance.CurrentDBDocument
uidoc=DocumentManager.Instance.CurrentUIApplication.ActiveUIDocument

#Preparing input from dynamo to revit
family = UnwrapElement(IN[0])
docs = []

#Do some action in a Transaction
TransactionManager.Instance.EnsureInTransaction(doc)
for symbId in family.GetFamilySymbolIds():
	symbol = doc.GetElement(symbId)
	if not symbol.IsActive:
		symbol.Activate()
		
TransactionManager.Instance.TransactionTaskDone()
TransactionManager.Instance.ForceCloseTransaction()
try:
	famDoc= doc.EditFamily(family)
	params = famDoc.FamilyManager.Parameters
	types = famDoc.FamilyManager.Types
	trans = Transaction(famDoc)
	trans.Start("test")
	for type in types:
		if type.Name == IN[1]:
			famDoc.FamilyManager.CurrentType = type
	for param in params:
		if param.Definition.Name == IN[2]:
			docs.append(famDoc.FamilyManager.Set(param,IN[3]))
	trans.Commit()
	famDoc.LoadFamily(doc,FamilyOption())
	famDoc.Close(False)
except:
	docs.append("Failed")



OUT = docs
# ----------------------------------------
code_block = CodeBlock { "Valore"; }
string = StringInput("Parametro")
