# Dynamo graph GuardRail_Profiler (Extrusion_Only).dyn "GuardRail_Profiler (Extrusion Only)" (Dynamo 2.12.0.5650)
# packages: bimorphNodes 5.1.3, Synthesize toolkit 24.1.1501

# group: Define Families
define_profile_family = FamilyTypes()  # nothing selected; graph input

# group: Profile_Geometry
end = Revit.Transaction.Transaction.End(input=define_profile_family)
geometry = Python(IN[0]=end)  # "Get.Profile.Geometry"; IronPython2
# ---------- geometry.python (56 lines) ----------
#Copyright(c) 2014, Konrad Sobon
# @arch_laboratory, http://archi-lab.net

import clr
clr.AddReference('ProtoGeometry')
from Autodesk.DesignScript.Geometry import *

# Import ToDSType(bool) extension method
clr.AddReference("RevitNodes")
import Revit
clr.ImportExtensions(Revit.Elements)

# Import DocumentManager and TransactionManager
clr.AddReference("RevitServices")
import RevitServices
from RevitServices.Persistence import DocumentManager
from RevitServices.Transactions import TransactionManager

from System.Collections.Generic import *

# Import RevitAPI
clr.AddReference("RevitAPI")
import Autodesk
from Autodesk.Revit.DB import *

doc = DocumentManager.Instance.CurrentDBDocument
uiapp = DocumentManager.Instance.CurrentUIApplication
app = uiapp.Application

#The inputs to this node will be stored as a list in the IN variable.
dataEnteringNode = IN
name = str(IN[0].Name)

#select family instance by name
collector = FilteredElementCollector(doc)
families = collector.OfClass(Family)

for i in families:
	if i.Name == name:
		family = i
		break
	else:
		continue

#extract profile curves from family(sketch)
famDoc = doc.EditFamily(family)
famCollector = FilteredElementCollector(famDoc)
sketch = famCollector.OfClass(Sketch)

#convert revit geometry to DS Geometry (lines, arc etc)
for i in sketch:
	cArray = list(i.Profile)
cArray[:] = [[Revit.GeometryConversion.RevitToProtoCurve.ToProtoType(y, True ) for y in x] for x in cArray]

#Assign your output to the OUT variable
OUT = cArray
# ----------------------------------------
byJoinedCurves = PolyCurve.ByJoinedCurves(curves=geometry)

# group: DWG_Selection
select_dwg = DSModelElementSelection()  # 1 picked in the model; graph input
define_layer = StringInput("3d Poly")  # graph input

# group: PolyCurve_by_DWG
curvesFromCADLayers = CAD.CurvesFromCADLayers(importInstance=select_dwg, layerNames=define_layer)
flatten = List.Flatten(list=curvesFromCADLayers.Curve)
firstItem = List.FirstItem(list=flatten)
restOfItems = List.RestOfItems(list=flatten)
join = Curve.Join(curve=firstItem, curves=restOfItems)

# group: Align_Origin
planeAtParameter = Curve.PlaneAtParameter(curve=join)
byPlane = CoordinateSystem.ByPlane(plane=planeAtParameter)
transform = Geometry.Transform(geometry=byJoinedCurves, cs=byPlane)

# group: Insert_Profile_FamilyInstance
bySweep = Solid.BySweep(profile=transform, path=join)
byUnion = Solid.ByUnion(solids=bySweep)
define_profile_category = Categories("OST_GenericModel")  # graph input
define_profile_name = StringInput("GuardRail")  # graph input
KFamilyInsert = SynthesizeToolkit.Revit.Family.KFamilyInsert(Geometry=byUnion, FamilyCategory=define_profile_category, OverrideFamilyName=define_profile_name)

# group: Buggy_Dynamo_Importer
number = DoubleInput(0.305)  # frozen
scale = Geometry.Scale(geometry=byUnion, amount=number)  # frozen
byGeometry = ImportInstance.ByGeometry(geometry=scale)
