# Dynamo graph GuardRail_Profiler (Picket_Only).dyn (Dynamo 2.12.0.5650)
# packages: bimorphNodes 5.1.3

# group: Define Family
define_family = FamilyTypes("ESIST_GuardRail-Caso A_Paletto:ESIST_GuardRail-Caso A_Paletto")  # graph input

# group: DWG_Selection
select_dwg = DSModelElementSelection()  # 1 picked in the model; graph input
define_layer = StringInput("3d Poly")  # graph input

# group: PolyCurve_by_DWG
curvesFromCADLayers = CAD.CurvesFromCADLayers(importInstance=select_dwg, layerNames=define_layer)
flatten = List.Flatten(list=curvesFromCADLayers.Curve)
firstItem = List.FirstItem(list=flatten)
restOfItems = List.RestOfItems(list=flatten)
join = Curve.Join(curve=firstItem, curves=restOfItems)

# group: Calc_Distance
length = Curve.Length(curve=join)
set_distance = DoubleInput(2.5)  # graph input
div = length / set_distance
number = DoubleInput(0)
round = Math.Round(number=div, digits=number)
div_2 = length / round

# group: Calc_%
number_2 = DoubleInput(100)
mul = div_2 * number_2
div_3 = mul / length
number_3 = DoubleInput(0)
sequence = Sequence(start=number_3, amount=round)
mul_2 = div_3 * sequence  # lacing=CrossProduct
number_4 = DoubleInput(100)
join_2 = List.Join(list0=mul_2, list1=number_4)
div_4 = join_2 / number_4

set_z_offset = DoubleInput(0)  # graph input

# group: Calc_Rotation
byTangency = Line.ByTangency(curve=join, parameter=div_4)
startPoint = Curve.StartPoint(curve=byTangency)
endPoint = Curve.EndPoint(curve=byTangency)
byTwoPoints = Vector.ByTwoPoints(start=startPoint, end=endPoint)
XAxis = Vector.XAxis()
ZAxis = Vector.ZAxis()
angleAboutAxis = Vector.AngleAboutAxis(vector=byTwoPoints, otherVector=XAxis, rotationAxis=ZAxis)

# group: Insert/Rotate/Elevate_FamilyInstances
pointAtParameter = Curve.PointAtParameter(curve=join, param=div_4)
X = Point.X(point=pointAtParameter)
set_x_offset = DoubleInput(0)  # graph input
add = X + set_x_offset
Y = Point.Y(point=pointAtParameter)
set_y_offset = DoubleInput(0)  # graph input
add_2 = Y + set_y_offset
Z = Point.Z(point=pointAtParameter)
add_3 = Z + set_z_offset
byCoordinates = Point.ByCoordinates(x=add, y=add_2, z=add_3)
byPoint = FamilyInstance.ByPoint(familyType=define_family, point=byCoordinates)
setRotation = FamilyInstance.SetRotation(familyInstance=byPoint, degree=angleAboutAxis)
