# Dynamo graph GuardRail_Profiler.dyn (Dynamo 2.12.0.5650)
# packages: bimorphNodes 5.1.3, Synthesize toolkit 24.1.1501

# group: Define Families
define_picket_family = FamilyTypes("ESIST_GuardRail-Caso A_Paletto:ESIST_GuardRail-Caso A_Paletto")  # graph input
define_profile_family = FamilyTypes()  # nothing selected; graph input

# group: DWG_Selection
select_dwg = DSModelElementSelection()  # 1 picked in the model; graph input
define_layer = StringInput("3d Poly")  # graph input

# group: PolyCurve_by_DWG
curvesFromCADLayers = CAD.CurvesFromCADLayers(importInstance=select_dwg, layerNames=define_layer)
flatten = List.Flatten(list=curvesFromCADLayers.Curve)
firstItem = List.FirstItem(list=flatten)
restOfItems = List.RestOfItems(list=flatten)
join = Curve.Join(curve=firstItem, curves=restOfItems)

# group: Calc_Distance
length = Curve.Length(curve=join)
set_distance = DoubleInput(2.5)  # graph input
div = length / set_distance
number = DoubleInput(0)
round = Math.Round(number=div, digits=number)
div_2 = length / round

# group: Calc_%
number_2 = DoubleInput(100)
mul = div_2 * number_2
div_3 = mul / length
number_3 = DoubleInput(0)
sequence = Sequence(start=number_3, amount=round)
mul_2 = div_3 * sequence  # lacing=CrossProduct
number_4 = DoubleInput(100)
join_2 = List.Join(list0=mul_2, list1=number_4)
div_4 = join_2 / number_4

# group: Calc_Rotation
byTangency = Line.ByTangency(curve=join, parameter=div_4)
startPoint = Curve.StartPoint(curve=byTangency)
endPoint = Curve.EndPoint(curve=byTangency)
byTwoPoints = Vector.ByTwoPoints(start=startPoint, end=endPoint)
XAxis = Vector.XAxis()
ZAxis = Vector.ZAxis()
angleAboutAxis = Vector.AngleAboutAxis(vector=byTwoPoints, otherVector=XAxis, rotationAxis=ZAxis)

# group: Insert/Rotate/Elevate_Picket_FamiliyInstances
pointAtParameter = Curve.PointAtParameter(curve=join, param=div_4)
X = Point.X(point=pointAtParameter)
set_x_offset = DoubleInput(0)  # graph input
add = X + set_x_offset
Y = Point.Y(point=pointAtParameter)
set_y_offset = DoubleInput(0)  # graph input
add_2 = Y + set_y_offset
Z = Point.Z(point=pointAtParameter)
set_z_offset = DoubleInput(0)  # graph input
add_3 = Z + set_z_offset
byCoordinates = Point.ByCoordinates(x=add, y=add_2, z=add_3)
byPoint = FamilyInstance.ByPoint(familyType=define_picket_family, point=byCoordinates)
setRotation = FamilyInstance.SetRotation(familyInstance=byPoint, degree=angleAboutAxis)

# group: Profile_Geometry
end = Revit.Transaction.Transaction.End(input=define_profile_family)
geometry = Python(IN[0]=end)  # "Get.Profile.Geometry"; IronPython2
# ---------- geometry.python (56 lines) ----------
#Copyright(c) 2014, Konrad Sobon
# @arch_laboratory, http://archi-lab.net

import clr
clr.AddReference('ProtoGeometry')
from Autodesk.DesignScript.Geometry import *

# Import ToDSType(bool) extension method
clr.AddReference("RevitNodes")
import Revit
clr.ImportExtensions(Revit.Elements)

# Import DocumentManager and TransactionManager
clr.AddReference("RevitServices")
import RevitServices
from RevitServices.Persistence import DocumentManager
from RevitServices.Transactions import TransactionManager

from System.Collections.Generic import *

# Import RevitAPI
clr.AddReference("RevitAPI")
import Autodesk
from Autodesk.Revit.DB import *

doc = DocumentManager.Instance.CurrentDBDocument
uiapp = DocumentManager.Instance.CurrentUIApplication
app = uiapp.Application

#The inputs to this node will be stored as a list in the IN variable.
dataEnteringNode = IN
name = str(IN[0].Name)

#select family instance by name
collector = FilteredElementCollector(doc)
families = collector.OfClass(Family)

for i in families:
	if i.Name == name:
		family = i
		break
	else:
		continue

#extract profile curves from family(sketch)
famDoc = doc.EditFamily(family)
famCollector = FilteredElementCollector(famDoc)
sketch = famCollector.OfClass(Sketch)

#convert revit geometry to DS Geometry (lines, arc etc)
for i in sketch:
	cArray = list(i.Profile)
cArray[:] = [[Revit.GeometryConversion.RevitToProtoCurve.ToProtoType(y, True ) for y in x] for x in cArray]

#Assign your output to the OUT variable
OUT = cArray
# ----------------------------------------
byJoinedCurves = PolyCurve.ByJoinedCurves(curves=geometry)

# group: Align_Origin
planeAtParameter = Curve.PlaneAtParameter(curve=join)
byPlane = CoordinateSystem.ByPlane(plane=planeAtParameter)
transform = Geometry.Transform(geometry=byJoinedCurves, cs=byPlane)

# group: Insert_Profile_FamilyInstance
bySweep = Solid.BySweep(profile=transform, path=join)
byUnion = Solid.ByUnion(solids=bySweep)
define_profile_category = Categories("OST_GenericModel")  # graph input
define_profile_name = StringInput("GuardRail")  # graph input
KFamilyInsert = SynthesizeToolkit.Revit.Family.KFamilyInsert(Geometry=byUnion, FamilyCategory=define_profile_category, OverrideFamilyName=define_profile_name)

# group: Buggy_Dynamo_Importer
number_5 = DoubleInput(0.305)  # frozen
scale = Geometry.Scale(geometry=byUnion, amount=number_5)  # frozen
byGeometry = ImportInstance.ByGeometry(geometry=scale)
