# Dynamo graph Rooms_to_LineGroups.dyn "Room_PolyLines" (Dynamo 2.10.1.3976)
# packages: archi-lab.net 2022.210.1022, Clockwork for Dynamo 2.x 2.4.0

# group: LineType
code_block = CodeBlock { "Stile di linea"; }
code_block_2 = CodeBlock { "Sovrapposto"; }
setParameterByName = Element.SetParameterByName(parameterName=code_block, value=code_block_2)  # unwired: element

# group: Room_Selection
categories = Categories("OST_Rooms")
all_elements_of_category = ElementsOfCategory(Category=categories)
getDocuments = archilab.Revit.Selection.Select.GetDocuments()
code_block_3 = CodeBlock(x=getDocuments.Link_Doc) { x[0]; }
get_all_elements_from_linked = Custom[Get All Elements From Linked Model](linkDoc=code_block_3, category=categories)  # package archi-lab.net; This node is based on code posted by Julien Benoit. Big thanks to Julien for sharing his work. This node will retrieve all elements of a given category from a given linked model.

# group: Create_PolyLines
coreBoundary = Room.CoreBoundary(room=get_all_elements_from_linked)
number = DoubleInput(1)
flatten = List.Flatten(list=coreBoundary, amt=number)
byCurve = ModelCurve.ByCurve(curve=flatten)

# group: Set&Name_Groups
byElements = Group.ByElements(elements=byCurve)
type = archilab.Revit.Elements.Elements.Type(element=byElements)
number_2 = Room.Number(room=get_all_elements_from_linked)
setName = Custom[Element.SetName](element=type, name=number_2)  # package Clockwork for Dynamo 2.x; Gets the name of a given Revit element
