# Dynamo graph Set_External_Property.dyn (Dynamo 1.3.4.6666)

# group: Assume Element Parameters
categories = Categories("MEPSpaces")
all_elements_of_category = ElementsOfCategory(categories)
string = StringInput("Number")
getParameterValueByName = Element.GetParameterValueByName(element=all_elements_of_category, parameterName=string)

# group: Assume Excel Parameters
file_path = Filename("..\..\..\..\622_Odense Fase 3\DATI\FASE 3 INPUT\Geographical number\230601_DP03-08-100 Room Number.csv")
fromPath = FileObject(file_path)  # "File.FromPath"
readFromFile = CSV.ReadFromFile(fromPath)
string_2 = StringInput(";")
split = String.Split(readFromFile, string_2)
restOfItems = List.RestOfItems(split)
flatten = Flatten(restOfItems@L2)
number = DoubleInput(5)
getItemAtIndex = List.GetItemAtIndex(list=flatten@L2, index=number)
number_2 = DoubleInput(4)
getItemAtIndex_2 = List.GetItemAtIndex(list=flatten@L2, index=number_2)

# group: Match Parameters
firstIndexOf = List.FirstIndexOf(list=getItemAtIndex_2, item=getParameterValueByName)
getItemAtIndex_3 = List.GetItemAtIndex(list=getItemAtIndex, index=firstIndexOf)
string_from_object = FromObject(getItemAtIndex_3)
string_3 = StringInput("null")
string_4 = StringInput("-")
replace = String.Replace(str=string_from_object, searchFor=string_3, replaceWith=string_4)

# group: Set Parameter Values
string_5 = StringInput("OHPT_Geographical number")
setParameterByName = Element.SetParameterByName(element=all_elements_of_category, parameterName=string_5, value=replace)
