# Dynamo graph Transfer_ViewFilters.dyn (Dynamo 2.10.1.3976)

# group: Inputs
vista_destinatazione = Views("Esempio Destinazione")  # graph input
vista_sorgente = Views("Esempio Muro Verde")  # graph input
nome_filtro = StringInput("Muro Mattoni")  # graph input

# group: Filter_Finder
filters = View.Filters(view=vista_sorgente)
name = Element.Name(element=filters)
contains = List.Contains(list=name, item=nome_filtro)
filterByBoolMask = List.FilterByBoolMask(list=filters, mask=contains)

# group: Set_Filter
addFilter = View.AddFilter(view=vista_destinatazione, parameterFilter=filterByBoolMask.in)
filterOverrides = View.FilterOverrides(view=vista_sorgente, parameterFilter=filterByBoolMask.in)
boolean = BoolSelector(true)
setFilterOverrides = View.SetFilterOverrides(view=addFilter, parameterFilter=filterByBoolMask.in, overrides=filterOverrides, hide=boolean)
