# Dynamo graph XLS_Parameter_Compiler.dyn (Dynamo 1.3.4.6666)

# group: Assume Element Parameters
categoria_revit = Categories("MEPSpaces")
all_elements_of_category = ElementsOfCategory(categoria_revit)
parametro_revit_di_riferimento = StringInput("OUH_ElectricalPanelboard")
getParameterValueByName = Element.GetParameterValueByName(element=all_elements_of_category, parameterName=parametro_revit_di_riferimento)

numero_celle_intestazione = DoubleInput(5)

# group: Assume Excel Parameters
seleziona_file_xls = Filename("..\Esempi\Spaces.xlsx")
fromPath = FileObject(seleziona_file_xls)  # "File.FromPath"
nome_foglio = StringInput("03. Switchboard sheet")
readFromFile = Excel.ReadFromFile(file=fromPath, sheetName=nome_foglio)
dropItems = List.DropItems(list=readFromFile, amount=numero_celle_intestazione)
numero_cella_da_prelevare_0_1 = DoubleInput(11)
getItemAtIndex = List.GetItemAtIndex(list=dropItems@L2, index=numero_cella_da_prelevare_0_1)
numero_cella_di_riscontro_0_1 = DoubleInput(10)
getItemAtIndex_2 = List.GetItemAtIndex(list=dropItems@L2, index=numero_cella_di_riscontro_0_1)

# group: Match Parameters
firstIndexOf = List.FirstIndexOf(list=getItemAtIndex_2, item=getParameterValueByName)
getItemAtIndex_3 = List.GetItemAtIndex(list=getItemAtIndex, index=firstIndexOf)
string_from_object = FromObject(getItemAtIndex_3)
string = StringInput("null")
string_2 = StringInput("-")
replace = String.Replace(str=string_from_object, searchFor=string, replaceWith=string_2)

# group: Set Parameter Values
parametro_revit_di_destinazione = StringInput("OHPT_TAG NAME PANEL")
setParameterByName = Element.SetParameterByName(element=all_elements_of_category, parameterName=parametro_revit_di_destinazione, value=replace)
